# Dynamo graph test_generated_wall_filter.dyn
# Test Dynamo Graph generated by Revit MCP

stringInput = StringInput("Generic - 200mm")
python = Python(IN[0]=stringInput)  # CPython3
# ---------- python.python (5 lines) ----------
import clr
clr.AddReference('RevitAPI')
from Autodesk.Revit.DB import *
collector = FilteredElementCollector(doc).OfClass(Wall)
OUT = [w.Name for w in collector if IN[0] in w.Name]
# ----------------------------------------
watch = Watch(python)
